# Grasshopper definition annual_daylight.gh (Grasshopper 1.0.7)

# ---- group: Opaque Faces
geo = Geometry([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])
roomsolid = HBRoomFromSolid(geo=flatten(geo), name="TestRoom", conditioned=True)  # -> report, rooms; plug-in component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

# ---- group: Apertures
# Geometry Preparation
panel = Panel("g_material")
glassmod = HBGlassModifier(name=panel, trans="0.55")  # -> modifier; plug-in component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
brep = Brep([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])
aperture = HBAperture(geo=brep, rad_mod=glassmod)  # -> report, apertures; plug-in component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
addsubface = HBAddSubface(hb_obj=flatten(roomsolid.rooms), sub_faces=flatten(aperture.apertures))  # -> hb_obj; plug-in component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
bordershades = HBExtrudedBorderShades(hb_objs=flatten(addsubface), depth="0.3")  # -> report, hb_objs; plug-in component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

# ---- group: Context!
brep_2 = Brep([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])
shade = HBShade(geo=brep_2)  # -> report, shades; plug-in component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

# ----
# Model
# + Grids
panel_2 = Panel("sample_model_grid")
model = HBModel(rooms=flatten(bordershades.hb_objs), shades=flatten(shade.shades), name=panel_2)  # -> report, model; plug-in component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
gridrooms = HBSensorGridFromRooms(rooms=bordershades.hb_objs, grid_size="1")  # -> grid, points, mesh; plug-in component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
assigngridsviews = HBAssignGridsAndViews(model=model.model, grids=flatten(gridrooms.grid))  # -> model; plug-in component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
vizwiref = HBVizualizeWireframe(hb_objs=flatten(model.model))  # -> geo; plug-in component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

# ----
# Wea
panel_3 = Panel("https://www.energyplus.net/weather-download/north_and_central_america_wmo_region_4/USA/MA/USA_MA_Boston-Logan.Intl.AP.725090_TMY3/all")
downloadepw = LBDownloadWeather(weather_URL=panel_3)  # -> epw_file, stat_file, ddy_file; plug-in component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
wea = HBWeaFromEPW(epw_file=downloadepw.epw_file)  # -> wea; plug-in component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

recipesettings = HBRecipeSettings(workers="8", reload_old=False)  # -> settings; plug-in component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

# ----
# Run Recipe
annualdaylight = HBAnnualDaylight(north=0, sensor_count=200, radiance_par=" ")  # -> recipe; plug-in component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
runrecipe = HBRunRecipe(recipe=annualdaylight, reload_old=False)  # -> report, results; plug-in component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

annualdaylight_2 = HBAnnualDaylight(model=assigngridsviews, wea=wea, sensor_count="30", run_settings=recipesettings, run=Toggle(False))  # -> report, results; plug-in component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

# ----
# Parse
# Results
panel_4 = Panel("500")
annualmetrics = HBAnnualDaylightMetrics(results=annualdaylight_2.results, threshold=panel_4)  # -> report, DA, UDI; plug-in component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
panel_5 = Panel(annualmetrics.DA)

# ----
# Visualize
# Results
data = Data(flatten(annualmetrics.DA))
mjoin = MeshJoin(Meshes=gridrooms.mesh)
heatmap = LBSpatialHeatmap(values=data, mesh=mjoin, legend_title="%")  # -> mesh, legend, title, colors, legend_par; plug-in component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
