# Grasshopper definition creating_skies.gh (Grasshopper 1.0.7)

txt = Text("https://www.energyplus.net/weather-download/north_and_central_america_wmo_region_4/USA/IL/USA_IL_Chicago-OHare.725300_TMY2/all")
downloadepw = LBDownloadWeather(weather_URL=txt)  # -> epw_file, stat_file, ddy_file; plug-in component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
importloc = LBImportLocation(epw_file=downloadepw.epw_file)  # -> location; plug-in component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

importepw = LBImportEPW(epw_file=downloadepw.epw_file)  # -> location, dry_bulb_temperature, dew_point_temperature, relative_humidity, wind_speed, wind_direction, direct_normal_rad, diffuse_horizontal_rad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; plug-in component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
zhang_huang = HBWeaFromZhangHuang(
    location=importloc,
    cloud_cover=importepw.total_sky_cover,
    rel_humidity=importepw.relative_humidity,
    dry_bulb_temp=importepw.dry_bulb_temperature,
    wind_speed=importepw.wind_speed,
    atmos_pressure=importepw.barometric_pressure)  # -> wea; plug-in component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

clearsky = HBClearSky(location=importloc)  # -> wea; plug-in component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
tauclearsky = HBTauClearSkyFromSTAT(stat_file=downloadepw.stat_file, timestep="1")  # -> wea; plug-in component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
wea = HBWeaFromEPW(epw_file=downloadepw.epw_file)  # -> wea; plug-in component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
decnstrwea = HBDeconstructWea(wea=zhang_huang)  # -> dir, diff, glob; plug-in component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
skymatrix = HBSkyMatrix(north=0, wea=wea, density=1)  # -> skymtx; plug-in component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
sunmatrix = HBSunMatrix(north=0, wea=tauclearsky)  # -> sunmtx; plug-in component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
climatebased = HBClimatebasedSky(wea=clearsky, month="9", hour="9")  # -> sky; plug-in component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
certainillum = HBCertainIlluminance()  # -> sky; plug-in component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
ciesky = HBCIEStandardSky(location=importloc, month=6, day=21, type=0)  # -> sky; plug-in component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
customsky = HBCustomSky(location=importloc, dir_rad="800", diff_rad="100", month=6, day=21, hour=12)  # -> sky; plug-in component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
hourlyplot = LBHourlyPlot(data=[decnstrwea.dir, decnstrwea.diff, decnstrwea.glob])  # -> report, mesh, legend, borders, labels, title; plug-in component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
